vi "FreqSync.gvi"   [LabVIEW NXG 3.0.0]
inputs:
  "input": c128[]
  "Training codes": c128[]
  "Samples per symbol": f64 = 1
  "error in": error
  "barker code": enum{"5", "7", "11", "random"} = "random"
  "Frame index": i32
outputs:
  "output": c128[]
  "error out": error
  "slope": f64
  "intercept": f64
  "phase offset": f64
uses:
  NI::Analysis::Generation::Ramp Pattern by Samples.gvi
  NI::Analysis::Conditioning::Unwrap Phase.gvi
  NI::Analysis::Fitting::Linear Fit.gvi
diagram:
  call "BarkerCode.gvi"(barker code=$"barker code") -> (subcodes=w1)
  Multiply(w1, $"Samples per symbol") -> w2
  call "Ramp Pattern by Samples.gvi"(samples=w1, end=w2, exclude end=TRUE) -> (ramp pattern=w3)
  # Estimate phase offset between sub codes
  Complex To Polar(r * e^(i*theta)=$"Training codes") -> (theta=w4)
  call "Unwrap Phase.gvi"(input phase=w4, phase unit="radian in, radian out"(0), error in=$"error in") -> (unwrapped phase=w5, error out=w6)
  # Create a linear array for the x axis
  Divide(x=f64 default, y=4) -> w7
  Add(w5, w7) -> w8
  call "Linear Fit.gvi"(method="Bisquare"(2), y=w8, x=w3, error in=w6) -> (slope=w9, intercept=w10, error out=w11)
  Multiply($"Samples per symbol", $"Frame index") -> w12
  # Compensate for phase offset
  Multiply(w9, w12) -> w13
  Subtract(x=w10, y=w13) -> w14
  Array Size(array=$input) -> (size(s)=w15)
  # n*phase/sub code length
  # from 0 to N
  Add(w15, 0) -> w16
  Multiply(w9, w16) -> w17
  # create phase compensation array
  call "Ramp Pattern by Samples.gvi"(samples=w16, end=w17, error in=w11) -> (ramp pattern=w18, error out=w19)
  Add(w18, w14) -> w20
  Negate(x=w20) -> w21
  Polar To Complex(r=1, theta=w21) -> (r * e^(i*theta)=w22)
  # compensate by multiplying with e^-j(n*phase/sub code length)
  Multiply($input, w22) -> w23
  $output <- w23
  # phase/subcode length
  $slope <- w9
  # remove sync frame compensation
  call "Unwrap Phase.gvi"(input phase=w20, phase unit="radian in, radian out"(0), error in=w19) -> (error out=w24)
  $"error out" <- w24
  $intercept <- w10
  $"phase offset" <- w14
